# Grasshopper definition arch_bridge_transformation_TD_4.gh (Grasshopper 1.0.7)
# plug-ins: Libra

point = Point(<point referenced from the Rhino model>)
point_2 = Point(<point referenced from the Rhino model>)
point_3 = Point(<point referenced from the Rhino model>)
point_4 = Point(<point referenced from the Rhino model>)
point_5 = Point(<point referenced from the Rhino model>)
point_6 = Point(<point referenced from the Rhino model>)
point_7 = Point(<point referenced from the Rhino model>)
point_8 = Point(<point referenced from the Rhino model>)
point_9 = Point(<point referenced from the Rhino model>)
point_10 = Point(<point referenced from the Rhino model>)
point_11 = Point(<point referenced from the Rhino model>)
point_12 = Point(<point referenced from the Rhino model>)
point_13 = Point(<point referenced from the Rhino model>)
point_14 = Point(<point referenced from the Rhino model>)
point_15 = Point(<point referenced from the Rhino model>)
point_16 = Point(<point referenced from the Rhino model>)
point_17 = Point(<point referenced from the Rhino model>)
point_18 = Point(<point referenced from the Rhino model>)
curve = Curve(<curve referenced from the Rhino model>)
vector_2pt = Vector2Pt(PointA=point, PointB=point_2, Unitize=False)  # -> Vector, Length
vector_2pt_2 = Vector2Pt(PointA=point_3, PointB=point_4, Unitize=False)  # -> Vector, Length
vector_2pt_3 = Vector2Pt(PointA=point_5, PointB=point_6, Unitize=False)  # -> Vector, Length
vector_2pt_4 = Vector2Pt(PointA=point_7, PointB=point_8, Unitize=False)  # -> Vector, Length
vector_2pt_5 = Vector2Pt(PointA=point_9, PointB=point_10, Unitize=False)  # -> Vector, Length
vector_2pt_6 = Vector2Pt(PointA=point_11, PointB=point_12, Unitize=False)  # -> Vector, Length
vector_2pt_7 = Vector2Pt(PointA=point_13, PointB=point_14, Unitize=False)  # -> Vector, Length
vector_2pt_8 = Vector2Pt(PointA=point_15, PointB=point_16, Unitize=False)  # -> Vector, Length
vector_2pt_9 = Vector2Pt(PointA=point_17, PointB=point_18, Unitize=False)  # -> Vector, Length
construct_domain = ConstructDomain(RegionsIn=curve)
merge = Merge(
    Data1=point_2,
    Data2=point_4,
    Data3=point_6,
    Data4=point_8,
    Data5=point_10,
    Data6=point_12,
    Data7=point_14,
    Data8=point_16,
    Data9=point_18)
merge_2 = Merge(
    Data1=vector_2pt.Vector,
    Data2=vector_2pt_2.Vector,
    Data3=vector_2pt_3.Vector,
    Data4=vector_2pt_4.Vector,
    Data5=vector_2pt_5.Vector,
    Data6=vector_2pt_6.Vector,
    Data7=vector_2pt_7.Vector,
    Data8=vector_2pt_8.Vector,
    Data9=vector_2pt_9.Vector)
construct_model = ConstructModel(AnchorNode=merge, ForceVector=merge_2, DesignDomain=construct_domain)
force_s_selection_rule = ValueList({"Random": 0, "ProximityToUserSelectedPoint": 1, "MinMagnitude": 2, "MaxMagnitude": 3, "Oldest": 4, "Newest": 5, "Closest": 6, "Furthest": 7, "ClosestToDomainCentroid": 8, "FurthestToDomainCentroid": 9, "ClosestToPtCloud": 10, "FurthestToPtCloud": 11}, selected="MaxMagnitude")
force_indeterminacies_rule = ValueList({"Random": 0, "UserDefinedMagnitude": 1}, selected="UserDefinedMagnitude")
node_placement_rule = ValueList({"Random": 0, "UserSelectedParam": 1, "UserSelectedPt": 2}, selected="UserSelectedParam")
gene_pool = GenePool(Decimals=0, Maximum=20, Minimum=0, Value=[7.13, 13.81, 10.38, 11.235])
topological_configuration = ValueList({"Inbetween": 0, "Peripheral": 1}, selected="Inbetween")
gene_pool_2 = GenePool(Decimals=2, Maximum=20, Minimum=-20, Value=[-5.74, 7.62, -1.81, -8.04, 2.23, 8.04, -5.36, 7.59, -2.46, 6.48, 3.13])
gene_pool_3 = GenePool(Decimals=2, Maximum=20, Minimum=-20, Value=[-5.74, 7.62, 0.76, -8.04, 2.23, 8.04, -5.36, 7.59, -2.46, 6.48, 3.13])
type_of_force_set = ValueList({"Monomial": 0, "Binomial": 1}, selected="Binomial")
number_slider = Slider(0.057, range=0..1)
construct_node_placement_rule = ConstructNodePlacementRule(NodePlacementRuleID=node_placement_rule, MinDistanceToModel=Slider(0.534, range=0..1), TParam=gene_pool_3)
construct_force_indeterminacies_rule = ConstructForceIndeterminaciesRule(ForceIndeterminaciesRuleID=force_indeterminacies_rule, Forces=gene_pool_2)
construct_force_selection_rule = ConstructForceSelectionRule(
    ForceSelectionRuleID=force_s_selection_rule,
    TypeOfForceSet=type_of_force_set,
    TopologicalConfiguration=topological_configuration,
    FlipForcesOrder=Toggle(True))
panel = Panel(construct_node_placement_rule)
entropy_rate = ValueList({"Convergence": -1, "Stagnation": 0, "Divergence": 1}, selected="Convergence")
construct_transformation_policy = ConstructTransformationPolicy(
    EntropyRate=entropy_rate,
    ForceSelectionRuleForcesSet=construct_force_selection_rule,
    NodePlacementRulePoint=construct_node_placement_rule,
    ForceIndeterminaciesRuleAxialForces=construct_force_indeterminacies_rule)
apply_transformation_policy = ApplyTransformationPolicy(Execute=Toggle(False), Iterations=Slider(3, range=1..10), Model=construct_model)
apply_transformation_policy_2 = ApplyTransformationPolicy(Execute=Toggle(True), Iterations=Slider(10, range=1..10), Model=construct_model, Policy=construct_transformation_policy)
design_space_exploration = DesignSpaceExploration(Genomes=gene_pool, Model=apply_transformation_policy_2)
design_space_exploration_storage = DesignSpaceExplorationStorage(design_space_exploration)
design_space_exploration_reader = DesignSpaceExplorationReader(Solution=design_space_exploration_storage, Branch=0)
