# Grasshopper definition simple_pylon_transformation_TD_working_2.gh (Grasshopper 1.0.7)
# plug-ins: Libra

pt = Point(<point referenced from the Rhino model>)
pt_2 = Point(<point referenced from the Rhino model>)
pt_3 = Point(<point referenced from the Rhino model>)
pt_4 = Point(<point referenced from the Rhino model>)
pt_5 = Point(<point referenced from the Rhino model>)
pt_6 = Point(<point referenced from the Rhino model>)
pt_7 = Point(<point referenced from the Rhino model>)
pt_8 = Point(<point referenced from the Rhino model>)
pt_9 = Point(<point referenced from the Rhino model>)
pt_10 = Point(<point referenced from the Rhino model>)
crv = Curve(<curve referenced from the Rhino model>)
vec2pt = Vector2Pt(PointA=pt, PointB=pt_2, Unitize=False)  # -> Vector, Length
vec2pt_2 = Vector2Pt(PointA=pt_3, PointB=pt_4, Unitize=False)  # -> Vector, Length
vec2pt_3 = Vector2Pt(PointA=pt_5, PointB=pt_6, Unitize=False)  # -> Vector, Length
vec2pt_4 = Vector2Pt(PointA=pt_7, PointB=pt_8, Unitize=False)  # -> Vector, Length
vec2pt_5 = Vector2Pt(PointA=pt_9, PointB=pt_10, Unitize=False)  # -> Vector, Length
constructdomain = ConstructDomain(RegionsIn=crv)
merge = Merge(Data1=pt_2, Data2=pt_4, Data3=pt_6, Data4=pt_8, Data5=pt_10)
merge_2 = Merge(Data1=vec2pt.Vector, Data2=vec2pt_2.Vector, Data3=vec2pt_3.Vector, Data4=vec2pt_4.Vector, Data5=vec2pt_5.Vector)
force_indeterminacies_rule = ValueList({"Random": 0, "UserDefinedMagnitude": 1}, selected="UserDefinedMagnitude")
constructmodel = ConstructModel(AnchorNode=merge, ForceVector=merge_2, DesignDomain=constructdomain)
number_slider = Slider(0.25, range=0..1)
number_slider_2 = Slider(0.56, range=0..1)
node_placement_rule = ValueList({"Random": 0, "UserSelectedParam": 1, "UserSelectedPt": 2}, selected="UserSelectedParam")
gene_pool = GenePool(Decimals=0, Maximum=1, Minimum=0, Value=[1, 0.4045, 1, 0.5, 0.6])
gene_pool_2 = GenePool(
    Decimals=2,
    Maximum=10,
    Minimum=-10,
    Value=[-4.12, -1.91, 5.04, -2.21, 1.84, -1.29, 1.84, 0, 0, 0, 0, 0, 0, 0, 0, 0, 0, 0, 0, 0, 0])
gene_pool_3 = GenePool(Decimals=2, Maximum=10, Minimum=-10, Value=[-4.12, -1.91, 7.31, 0, 0, 0, 0])
force_s_selection_rule = ValueList({"Random": 0, "ProximityToUserSelectedPoint": 1, "MinMagnitude": 2, "MaxMagnitude": 3, "Oldest": 4, "Newest": 5, "Closest": 6, "Furthest": 7, "ClosestToDomainCentroid": 8, "FurthestToDomainCentroid": 9, "ClosestToPtCloud": 10, "FurthestToPtCloud": 11}, selected="FurthestToDomainCentroid")
topological_configuration = ValueList({"Inbetween": 0, "Peripheral": 1}, selected="Inbetween")
gene_pool_4 = GenePool(Decimals=2, Maximum=10, Minimum=-10, Value=[-4.12, -1.91, 2.15])
type_of_force_set = ValueList({"Monomial": 0, "Binomial": 1}, selected="Binomial")
gene_pool_5 = GenePool(Decimals=0, Maximum=10, Minimum=0, Value=[2.94, 4.045, 1.5, 5, 6, 3, 5])
construct_force_indeterminacies_rule = ConstructForceIndeterminaciesRule(ForceIndeterminaciesRuleID=force_indeterminacies_rule)
boolean_toggle = BooleanToggle(False)
construct_node_placement_rule = ConstructNodePlacementRule(NodePlacementRuleID=node_placement_rule, MinDistanceToModel=Slider(0.42, range=0..1))
get_boolean = GetBoolean(AtLeast=1, AtMost=1, FalseValue="False", TreeAccess=False, TrueValue="True")
construct_force_selection_rule = ConstructForceSelectionRule(
    ForceSelectionRuleID=gene_pool_5,
    TypeOfForceSet=type_of_force_set,
    TopologicalConfiguration=topological_configuration,
    FlipForcesOrder=Toggle(True))
entropy_rate = ValueList({"Convergence": -1, "Stagnation": 0, "Divergence": 1}, selected="Divergence")
construct_transformation_policy = ConstructTransformationPolicy(
    EntropyRate=entropy_rate,
    ForceSelectionRuleForcesSet=construct_force_selection_rule,
    NodePlacementRulePoint=construct_node_placement_rule,
    ForceIndeterminaciesRuleAxialForces=construct_force_indeterminacies_rule)
apply_transformation_policy = ApplyTransformationPolicy(Execute=Toggle(True), Iterations=Slider(8, range=1..30), Model=constructmodel, Policy=construct_transformation_policy)
model_metrics_spider_graph = ModelMetricsSpiderGraph(Model=apply_transformation_policy, Plane=PlaneXY(0, 0, 0), Scale=1, Height=1, VerticalDistance=1, RadialDistance=1)  # -> GraphLines, MetricsLine, Text
model_metrics_text = ModelMetricsText(Model=apply_transformation_policy)  # -> Metrics, StaticAction, NumberOfBars, NumberOfNodes, DegreeOfNonPlanarity, TemporaryForces, MinBarLength, MaxBarLength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
design_space_exploration = DesignSpaceExploration(Genomes=gene_pool_5, Model=apply_transformation_policy, Objectives=model_metrics_text.NumberOfNodes)
design_space_exploration_reader = DesignSpaceExplorationReader(Branch=0)
design_space_exploration_storage = DesignSpaceExplorationStorage(design_space_exploration)
design_space_exploration_reader_2 = DesignSpaceExplorationReader(Branch=0)
